% Simulink data dictionary BMS_System_dict1.sldd

CANBusInterface = Simulink.Bus()
ChargerInterface = Simulink.Bus()
DataAcqBus = Simulink.Bus()
DataCalcBus = Simulink.Bus()
EstimationBusInterface = Simulink.Bus()
HMIInterface = Simulink.Bus()
OperationControl = Simulink.Bus()
SafetyInterface = Simulink.Bus()
ThermalInterface = Simulink.Bus()
UDSInterface = Simulink.Bus()