% Simulink data dictionary BMS_System_Arch_dict.sldd

BMS_InternalData_IF = Simulink.Bus()
  soc: double, Unit="%"
  packVoltage: double, Unit="V"
  packCurrent: double, Unit="A"
  tempMax: double, Unit="°C"
  tempMin: double, Unit="°C"
  sopCharge: double, Unit="kW"
  sopDischarge: double, Unit="kW"

BMS_VCU_IF = Simulink.Bus()
  soc: double, Unit="%"
  packVoltage: double, Unit="V"
  packCurrent: double, Unit="A"
  tempStatus: int16, Unit="°C"
  sopCharge: double, Unit="kW"
  sopDischarge: double, Unit="kW"

CAN_RxFrame_IF = Simulink.Bus()
  frameID: double
  frameData: double
  frameValid: boolean

CAN_TxFrame_IF = Simulink.Bus()
  frameID: double
  frameData: double
  dlc: double, Unit="bytes"
  txPeriod_ms: double, Unit="ms"

CellLimits_IF = Simulink.Bus()
  maxCellVoltage: double
  minCellVoltage: double

ChargeParams_IF = Simulink.Bus()
  voltageTarget: double, Unit="V"
  currentLimit: double, Unit="V"
  chargeEnable: boolean

ChargePlug_IF = Simulink.Bus()
  plugDetected: boolean
  evseHandshake: boolean

ChargeStatus_IF = Simulink.Bus()
  chargePct: int8, Unit="%"
  eta_min: double
  chargeMode: double

Contactor_IF = Simulink.Bus()
  contactorCmd: double
  prechargeEnable: double

DTC_IF = Simulink.Bus()
  dtcCode: double
  freezeFrameSOC: double
  freezeFrameVoltage: double
  freezeFrameTemp: double

DataLog_IF = Simulink.Bus()
  logSOC: double, Unit="%"
  logVoltage: double, Unit="V"
  logCurrent: double, Unit="A"
  logTemp: double, Unit="°C"
  logTimestamp: double, Unit="ms"

EVSE_Cap_IF = Simulink.Bus()
  maxVoltage_V: double, Unit="V"
  maxCurrent_A: double

FaultEvent_IF = Simulink.Bus()
  faultID: double
  faultSeverity: double  % 0=INFO,1=WARN,2=CRIT)
  faultTimestamp: double, Unit="ms"

FaultReaction_IF = Simulink.Bus()
  reactionCmd: double  % 0=ENABLE,1=DISABLE,2=SAFE)
  reactionLatency_ms: double, Unit="ms"

Fault_IF = Simulink.Bus()
  faultSeverity: double
  safeStateFlag: double

ModeStatus_IF = Simulink.Bus()
  activeMode: double  % (0..5)
  modeTimestamp: double, Unit="ms"

PackElectrical_IF = Simulink.Bus()
  packVoltage: double
  packCurrent: double

SOC_IF = Simulink.Bus()
  soc: double

SoP_IF = Simulink.Bus()
  sopCharge: double
  sopDischarge: double

StateData_IF = Simulink.Bus()
  soc: double
  sopCharge: double
  rangeEstimate: double

Temp_IF = Simulink.Bus()
  tempMax: double
  tempMin: double

UDS_Request_IF = Simulink.Bus()
  canID: double
  serviceID: double
  requestData: double

UDS_Response_IF = Simulink.Bus()
  responseCanID: double
  responseData: double
  responseValid: double

VCU_Request_IF = Simulink.Bus()
  powerRequest_kW: double, Unit="kW"
  requestValid: boolean

Wake_IF = Simulink.Bus()
  canNM_Wake: double
  kl15_signal: double